# Requirement set DevChallengeETRSReqs (R2025a)

## 1 [ETRS 1] The PSC shall command "TransmissionPosition" to replicate the highest priority range change request from the vehicle when the corresponding conditions are met

### 1.1 [ETRS 1.1] If "ElectronicTransmissionRangeSel" indicates PARK or "ParktoChargeRequested" is True and "ElectricParkBrakeApplied" is True and "ElectricParkBrakeAvailable" is Available and "VehicleSpeed" is less than 0.5 , "TransmissionPosition" shall indicate PARK

#### 1.1.1 [ETRS 1.1.1] When "ParktoChargeRequested" is True and "TransmissionPosition" is PARK, the PSC shall keep "TransmissionPosition" in PARK

### 1.2 [ETRS 1.2] If "ElectronicTransmissionRangeSel" indicates REVERSE and "ElectricParkBrakeApplied" is False and the Propulsion system is Active, "TransmissionPosition" shall indicate REVERSE

### 1.3 [ETRS 1.3] If "ElectronicTransmissionRangeSel" indicates NEUTRAL, "TransmissionPosition" shall indicate NEUTRAL

### 1.4 [ETRS 1.4] If "ElectronicTransmissionRangeSel" indicates DRIVE and "ElectricParkBrakeApplied" is False AND the Propulsion system is Active, "TransmissionPosition" shall indicate DRIVE

## 2 [ETRS 2] The PSC shall indicate NEUTRAL via "TransmissionPosition" when the parking brake is not in the correct status for the requested gear

### 2.1 [ETRS 2.1] If "ElectronicTransmissionRangeSel" indicates DRIVE/REVERSE and the ElectricParkBrakeApplied is False, the PSC shall indicate NEUTRAL via "TransmissionPosition"

### 2.2 [ETRS 2.2] If "ElectronicTransmissionRangeSel" indicates PARK or "ParktoChargeRequested" is True and the "ElectricParkBrakeApplied" is False, the PSC shall indicate NEUTRAL via "TransmissionPosition"

## 3 [ETRS 3] The PSC shall not allow unsafe gear changes while the vehicle is in motion

### 3.1 [ETRS 3.1] The PSC shall only allow a shift to PARK if the vehicle speed is below 0.5 km/h

### 3.2 [ETRS 3.2] When the vehicle is in motion above 0.5 km/h, the PSC shall not allow a shift to the propulsion mode which does not correspond to the vehicle's direction (i.e., it would not allow shifting to reverse while the vehicle is moving forward)

## 4 [ETRS 4] The PSC shall require the brake to be pressed for gear changes that could otherwise cause harm or significantly damage the vehicle

### 4.1 [ETRS 4.1] The PSC shall not allow a shift out of PARK if the brake is not pressed