test file "ETRSTests"
  coverage: Decision, MCDC, SignalRange, SimulinkDesignVerifier, RelationalBoundary, Condition, LookupTable, SignalSize, SaturationOnIntOverflow

suite "ETRS1"

  case "ETRS_1_1Chng2Park" [baseline]
    model DevChallengeETRS, stop time 35
    input "ETRSInputs.mat", mapped to ElectronicTransmissionRangeSel, ParktoChargeRequested, ElectricParkBrakeAvailable, ElectricParkBrakeApplied, Park_BrakePressed, VehicleSpeed, HVShutdownRequested, VehicleSystemEnabled (active)

  case "ETRS_1_1_1StayPark" [baseline]
    model DevChallengeETRS, mode Normal, start time 0, stop time 10

  case "ETRS_1_2Chng2Rvrs" [baseline]
    model DevChallengeETRS, mode Normal, start time 0, stop time 10
    input "ETRSInputs.mat", mapped to ElectronicTransmissionRangeSel, ParktoChargeRequested, ElectricParkBrakeAvailable, ElectricParkBrakeApplied, Park_BrakePressed, VehicleSpeed, HVShutdownRequested, VehicleSystemEnabled (active)

  case "ETRS_1_3Chng2Ntrl" [baseline]
    model DevChallengeETRS, mode Normal, start time 0, stop time 10

  case "ETRS_1_4Chng2Drv" [baseline]
    model DevChallengeETRS, mode Normal, start time 0, stop time 10

suite "ETRS2"

  case "ETRS_2_1EPB_DrvRvrs_Ntrl" [baseline]
    model DevChallengeETRS, mode Normal, start time 0, stop time 10

  case "ETRS_2_2EPB_Prk_Ntrl" [baseline]
    model DevChallengeETRS, mode Normal, start time 0, stop time 10

suite "ETRS3"

  case "ETRS_3_1PrkSpd" [baseline]
    model DevChallengeETRS, mode Normal, start time 0, stop time 10
    input "ETRSInputs.mat", mapped to ElectronicTransmissionRangeSel, ParktoChargeRequested, ElectricParkBrakeAvailable, ElectricParkBrakeApplied, Park_BrakePressed, VehicleSpeed, HVShutdownRequested, VehicleSystemEnabled (active)

  case "ETRS_3_2InvldShftSpd" [baseline]
    model DevChallengeETRS, mode Normal, start time 0, stop time 10

suite "ETRS4"

  case "ETRS_4_1BrkShftPrk" [baseline]
    model DevChallengeETRS, mode Normal, start time 0, stop time 10